vi "Interleaver.gvi"   [LabVIEW NXG 3.0.0]
inputs:
  "data in": i32[]
  "error in": error
  "number of rows": i32 = 50
  "number of columns": i32 = 50
  "selector": enum{"TX", "RX"} = "TX"
outputs:
  "data out": i32[]
  "error out": error
uses:
  NI::Modulation::MT Block Interleave (Matrix).gvi
  NI::Modulation::MT Block DeInterleave (Matrix).gvi
diagram:
  case ($selector) {
    frame "TX" {
      call "MT Block Interleave (Matrix).gvi"(data in=$"data in", number of rows=$"number of rows", number of columns=$"number of columns", error in=$"error in") -> (data out=w2, error out=w1)
    }
    frame "RX" {
      call "MT Block DeInterleave (Matrix).gvi"(data in=$"data in", number of rows=$"number of rows", number of columns=$"number of columns", error in=$"error in") -> (data out=w2, error out=w1)
    }
  }
  $"data out" <- w2
  $"error out" <- w1
