vi "FrameSync.gvi"   [LabVIEW NXG 3.0.0]
inputs:
  "input signal": c128[]
  "barker code": enum{"5", "7", "11", "random"} = "random"
  "sync frame index (symbols)": i32 = 16
  "samples per symbol": f64 = 16
  "message length (symbols)": i32 = 16
  "error in": error
  "Min correlation": f64
  "Exclude start and end": bool
outputs:
  "output signal": c128[]
  "max index": i32
  "Training Subcodes": c128[]
  "error out": error
  "Correlation": f64[]
uses:
  NI::Analysis::Operations::1D Cross Correlation (CDB).gvi
  NI::G Core::Error::Build Error Cluster.gvi
diagram:
  call "BarkerCode.gvi"(barker code=$"barker code") -> (code=w1, length of one subcode=w2, subcodes=w3)
  Array Size(array=w1) -> (size(s)=w4)
  To Long Integer(number=$"samples per symbol") -> w5
  Multiply(w4, w5) -> w6
  Multiply($"sync frame index (symbols)", w5) -> w7
  Array Size(array=$"input signal") -> (size(s)=w8)
  Multiply($"message length (symbols)", w5) -> w9
  Add(w6, w9) -> w10
  Subtract(x=w8, y=w10) -> w11
  # Exclude start and end of signal
  case ($"Exclude start and end") {
    frame False, Default {
      w12 = $"input signal"
    }
    frame True {
      Array Subset(array=$"input signal", index0=w7, length0=w11) -> w12
    }
  }
  To Double Precision Complex(number=w1) -> w13
  call "Upsampler.gvi"(Signal in=w13, Samples per symbol=$"samples per symbol", error in=$"error in") -> (Upsampled signal=w14, error out=w15)
  Array Size(array=w14) -> (size(s)=w16)
  Array Size(array=w12) -> (size(s)=w17)
  Is Greater Than 0(x=w17) -> w18
  Decrement(x=w17) -> w19
  Initialize Array(element=0, size=w19) -> w20
  # Perform cross correlation between the signal and each of the subcodes
  case (w18) {
    frame False, Default {
      w21 = w15
      w22 = f64[] []
      w23 = c128[][] []
      w24 = TRUE
    }
    frame True {
      s1 = w20  # shift register
      s2 = w15  # shift register
      for (N = w3) (iteration -> i1) {
        call "Subcodemask.gvi"(input=w14, subcode length=w2, samples per symbol=$"samples per symbol", index=i1) -> (output=w25)
        call "1D Cross Correlation (CDB).gvi"(x=w12, y=w25, error in=s2) -> (Rxy=w26, error out=w27)
        Reverse 1D Array(array=w26) -> (reversed array=w28)
        Array Subset(array=w28, index0=w16) -> w29
        # Moves the position of the subcode
        # so that the correlation indices overlap
        Absolute Value(x=w29) -> w30
        Add(s1, w30) -> w31
        append w29 to w23
        next s1 = w31
        next s2 = w27
      }
      w21 = s2
      w22 = s1
      w24 = FALSE
    }
  }
  Array Max And Min(array=w22) -> (max index(es)=w32, max value=w33)
  # Find index and value of max correlation
  Increment(x=w32) -> w34
  Subtract(x=w34, y=w7) -> w35
  Array Subset(array=w12, index0=w35) -> w36
  # Shift the signal with the sync index
  # Remove sync frame from the signal
  case (FALSE) {
    frame False, Default {
      w37 = w36
    }
    frame True {
      Delete From Array(inArray=w36, length (1)=w6, index0=w7) -> w37
    }
  }
  $"output signal" <- w37
  $"max index" <- w34
  $Correlation <- w22
  # Creates array of the correlated
  # subcodes at the max correlation
  for {
    w38 = each element of w23
    Array Index(array=w38) -> (out0[w32]=w40)
    append w40 to w39
  }
  $"Training Subcodes" <- w39
  Is Less(x=w33, y=$"Min correlation") -> w41
  Logical Or(w41, w24) -> w42
  case (w42) {
    frame False, Default {
      w43 = w21
    }
    frame True {
      call "Build Error Cluster.gvi"(error in=w21, code=1234567, description="Frame sync failed") -> (error out=w43)
    }
  }
  $"error out" <- w43
