vi "FreqSync.gvi"   [LabVIEW NXG 3.0.0]
inputs:
  "input": c128[]
  "Training codes": c128[][]
  "Samples per symbol": f64 = 1
  "error in": error
  "barker code": enum{"5", "7", "11", "random"} = "random"
  "Frame index": i32
outputs:
  "output": c128[]
  "error out": error
  "phase drift": f64
  "intercept": f64
  "phase offset": f64
  "correction angles": f64[]
panel indicators:
  "best linear fit": f64[]
uses:
  NI::Analysis::Statistics::Median.gvi
  NI::Analysis::Generation::Ramp Pattern by Samples.gvi
  NI::Analysis::Conditioning::Unwrap Phase.gvi
  NI::Analysis::Fitting::Linear Fit.gvi
  NI::Analysis::Geometry::Wrap Angle (Scalar DBL).gvi
diagram:
  Array Index(array=$"Training codes") -> (out0[0, _]=w1)
  Array Size(array=$"Training codes") -> (size(s)=w2)
  Array Index(array=w2) -> (out0[0]=w3)
  Decrement(x=w3) -> w4
  # Moose's algorithm
  for (N = w4) (iteration -> i1) {
    Increment(x=i1) -> w6
    Array Index(array=$"Training codes") -> (out0[w6, _]=w7)
    Array Size(array=w7) -> (size(s)=w8)
    Multiply(w8, w6) -> w9
    Complex Conjugate(x + iy=w1) -> w10
    Multiply(w10, w7) -> w11
    Add Array Elements(numeric array=w11) -> (sum=w12)
    Complex To Polar(r * e^(i*theta)=w12) -> (theta=w13)
    Divide(x=w13, y=w9) -> w14
    append w14 to w5
  }
  call "Median.gvi"(x=w5) -> (median=w15)
  $"phase drift" <- w15
  call "BarkerCode.gvi"(barker code=$"barker code") -> (subcodes=w16)
  disable {
    frame Enabled {
      w17 = default
      w18 = default
    }
    frame Disabled {
      Multiply(w16, $"Samples per symbol") -> w19
      call "Ramp Pattern by Samples.gvi"(samples=w16, end=w19, exclude end=TRUE) -> (ramp pattern=w20)
      Complex To Polar(r * e^(i*theta)=[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]) -> (theta=w21)
      call "Unwrap Phase.gvi"(input phase=w21, phase unit="radian in, radian out"(0), error in=$"error in") -> (unwrapped phase=w22, error out=w23)
      # Create a linear array for the x axis
      # Compensate for phase offset
      # Estimate phase offset between sub codes
      Divide(x=f64 default, y=4) -> w24
      Add(w22, w24) -> w25
      call "Linear Fit.gvi"(method="Least Square"(0), y=w25, x=w20, error in=w23) -> (best linear fit=w26, slope=w27, intercept=w28, error out=w17)
      # phase/subcode length
      $"best linear fit" <- w26
      $intercept <- w28
      Multiply($"Samples per symbol", $"Frame index") -> w29
      Multiply(w27, w29) -> w30
      Subtract(x=w28, y=w30) -> w31
      call "Wrap Angle (Scalar DBL).gvi"(angle=w31, wrapped angle range="-180 to 180 (-pi to pi)"(1), angle units="radian in, radian out"(0)) -> (wrapped angle=w18)
    }
  }
  Array Size(array=$input) -> (size(s)=w32)
  # n*phase/sub code length
  # from 0 to N
  Add(w32, 0) -> w33
  Multiply(w15, w33) -> w34
  # create phase compensation array
  call "Ramp Pattern by Samples.gvi"(samples=w33, end=w34, error in=w17) -> (ramp pattern=w35, error out=w36)
  Add(w35, w18) -> w37
  Negate(x=w37) -> w38
  Polar To Complex(r=1, theta=w38) -> (r * e^(i*theta)=w39)
  # compensate by multiplying with e^-j(n*phase/sub code length)
  Multiply($input, w39) -> w40
  $output <- w40
  # remove sync frame compensation
  $"error out" <- w36
  $"phase offset" <- w18
