vi "Receiver.gvi"   [LabVIEW NXG 3.0.0]
inputs:
  "Signal in": c128[]
  "error in": error
  "IQ rate": f64
  "filter parameter": f64 = 0.5
  "filter length": i32 = 8
  "message length (symbols)": i32 = 16
  "sync frame index (symbols)": i32 = 16
  "barker code": enum{"5", "7", "11", "random"} = "random"
  "Symbol rate (sym/s)": i32
  "Min correlation": f64
  "Frame sync": bool
  "Freq sync": bool
  "Interleaver": bool
  "decoding": bool
  "sync frame buffer (symbols)": i32 = 16
outputs:
  "output bit stream": i32[]
  "error out": error
  "Correlation": f64[]
  "IQ diagram": c128[]
  "Symbols downsampled (real)": f64[]
  "Baseband signal (real part)": cluster{"t0": f64, "dt": f64, "Y": f64[]}
  "Eye Diagram (real part)": cluster{"t0": f64, "dt": f64, "Y": f64[]}[]
uses:
  NI::G Core::Error::Filter Error Code.gvi
  NI::Modulation::MT Format Eye Diagram (complex).gvi
diagram:
  Divide(x=$"IQ rate", y=$"Symbol rate (sym/s)") -> w1
  To Long Integer(number=w1) -> w2
  # Matched filter
  call "PulseShaping.gvi"(Signal in=$"Signal in", Samples per symbol=w2, filter parameter=$"filter parameter", filter length=$"filter length", error in=$"error in", tx or rx="Rx") -> (signal out=w3, error out=w4)
  call "NormalizeVector.gvi"(Vector=w3) -> (Normalized Vector=w5)
  # Frame synch
  case ($"Frame sync") {
    frame False, Default {
      w6 = f64[] []
      w7 = w4
      w8 = w5
      w9 = c128[][] []
    }
    frame True {
      call "FrameSync.gvi"(input signal=w5, samples per symbol=w2, sync frame buffer (symbols)=$"sync frame buffer (symbols)", error in=w4, sync frame index (symbols)=$"sync frame index (symbols)", barker code=$"barker code", Min correlation=$"Min correlation") -> (output signal=w8, Correlation=w6, Training Subcodes=w9, error out=w7)
    }
  }
  Logical And($"Freq sync", $"Frame sync") -> w10
  # Frequency synch
  case (w10) {
    frame False, Default {
      w11 = w7
      w12 = w8
    }
    frame True {
      call "FreqSync.gvi"(input=w8, Training codes=w9, Samples per symbol=w2, Frame index=$"sync frame index (symbols)", error in=w7, barker code=$"barker code") -> (output=w12, error out=w11)
    }
  }
  case ($"Frame sync") {
    frame False, Default {
      w13 = w12
    }
    frame True {
      call "RemoveSyncFrame.gvi"(input=w12, samples per symbol=w2, sync frame index (bits)=$"sync frame index (symbols)", barker code=$"barker code") -> (output=w13)
    }
  }
  call "Downsampler.gvi"(input signal=w13, error in=w11, samples per symbol=w2) -> (output signal=w14, error out=w15)
  # Downsample
  case (w15) {
    frame Error, Default {
      w16 = i8[] []
      w17 = w15
    }
    frame No Error {
      # Symbol mapping
      call "BPSKDemod.gvi"(symbols=w14, error in=w15) -> (output bit stream=w16, error out=w17)
    }
  }
  # Scrambler?
  call "FrameScrambler.gvi"(input=w16, error in=w17) -> (output=w18, error out=w19)
  case ($Interleaver) {
    frame False, Default {
      w20 = w18
      w21 = w19
    }
    frame True {
      call "Interleaver.gvi"(data in=w18, Message length=$"message length (symbols)", error in=w19, selector="RX", Coding=$decoding) -> (data out=w20, error out=w21)
    }
  }
  case ($decoding) {
    frame False, Default {
      Array Subset(array=w20, length0=$"message length (symbols)") -> w22
      w23 = w21
    }
    frame True {
      # Decoding
      call "decode.gvi"(input data=w20, error in=w21) -> (output bit stream=w24, error out=w23)
      # trim remaining section
      Array Subset(array=w24, length0=$"message length (symbols)") -> w22
    }
  }
  $"output bit stream" <- w22
  $Correlation <- w6
  call "Filter Error Code.gvi"(error in=w23, code to clear=1234567) -> (error out=w25)
  # Ignore frame not found error
  $"error out" <- w25
  $"IQ diagram" <- w14
  Complex To Real Imaginary(x + iy=w14) -> (x=w26)
  $"Symbols downsampled (real)" <- w26
  Reciprocal(x=$"IQ rate") -> w27
  Complex To Real Imaginary(x + iy=w13) -> (x=w28)
  To Long Integer(number=w2) -> w29
  Multiply(w29, $"message length (symbols)") -> w30
  Array Subset(array=w28, length0=w30) -> w31
  # Plot signal
  Decimate Array(array=w31) -> (out1=w32)
  w33 = cluster{"t0": f64, "dt": f64, "Y": f64[]} {all zero or empty}
  Property Node(instance in=w33, "Y"=w32, "dt"=w27) -> (instance out=w34)  # Cluster Properties
  $"Baseband signal (real part)" <- w34
  call "MT Format Eye Diagram (complex).gvi"(waveform=w34, symbol rate=$"IQ rate", eye length=2) -> (eye diagram=w35)
  $"Eye Diagram (real part)" <- w35
