vi "ReceiverBlock2.0.gvi"   [LabVIEW NXG 3.0.0]
panel controls:
  "IQ rate": f64 = 160000
  "carrier frequency": f64 = 2450000000
  "gain (dB)": f64 = 20
  "active antenna": string = "RX2"
  "Device names": string = "USRP_06"
  "RF Channel": string = "1"
  "Symbol rate (sym/s)": i32 = 10000
  "filter length": i32 = 8
  "message length (symbols)": i32 = 128
  "sync frame index (symbols)": i32 = 64
  "Power Threshold": f64 = 1e-07
  "Frame sync": bool = TRUE
  "Freq sync": bool = TRUE
  "barker code": enum{"5", "7", "11", "random"} = "11"
  "decoding": bool
  "Interleaver": bool
  "filter parameter": f64 = 0.5
  "number of samples per USRP fetch": i64 = 20000
  "Stop_RX_2": bool
  "milliseconds to wait": u32
  "Reset BER": bool
  "Receive sound": bool
  "window length": i32 = 20
  "Extra buffer backwards": i32 = 50
  "receiver on": bool = TRUE
  "y": i32 = 500
  "preamble?": bool = TRUE
  "preamble code": enum{"5", "7", "11", "random"} = "7"
  "Correlation threshold": f64 = 0.001
  "Min correlation": f64 = 0.9
  "sync frame buffer (symbols)": i32 = 24
panel indicators:
  "actual IQ rate": f64
  "actual carrier frequency": f64
  "actual gain (dB)": f64
  "error out": error
  "dequeueing iteration": i32
  "IQ diagram": c128[]
  "samples/symbol": f64
  "sync frame correlation": f64[]
  "enqueueing iteration": i32
  "size(s)": i32
  "number elements in queue": i32
  "current index": i32
  "one package": f64[]
  "BER graph": f64[]
  "Mean_BER": f64
  "current BER": f64
  "Input array size": i32
  "Output array size": i32
  "Correct Size": bool
  "string": string
  "Raw input": f64[]
  "max correlation": f64
  "milliseconds": u32
  "FPS": f64
uses:
  NI::USRP::niUSRP Open Rx Session.gvi
  NI::USRP::niUSRP Configure Signal.gvi
  NI::USRP::niUSRP Initiate.gvi
  NI::USRP::niUSRP Fetch Rx Data (CDB).gvi
  NI::Modulation::MT Pack Bits.gvi
  NI::USRP::niUSRP Abort.gvi
  NI::USRP::niUSRP Close Session.gvi
diagram:
  w1 = $"RF Channel"
  call "niUSRP Open Rx Session.gvi"(device names=$"Device names") -> (session handle out=w2, error out=w3)
  Property Node(instance in=w2, "niUSRP"=w1, error in=w3) -> (error out=w4, instance out=w5)
  call "niUSRP Configure Signal.gvi"(active antenna=$"active antenna", session handle=w5, error in=w4, IQ rate=$"IQ rate", carrier frequency=$"carrier frequency", gain=$"gain (dB)", channel list=w1) -> (session handle out=w6, error out=w7, coerced IQ rate=w8, coerced carrier frequency=w9, coerced gain=w10)
  call "niUSRP Initiate.gvi"(session handle=w6, error in=w7) -> (session handle out=w11, error out=w12)
  Obtain Notifier(element data type=bool TRUE, error in=w12, name="error") -> (error out=w13, notifier out=w14)
  Obtain Queue(element data type=c128[] [], error in=w13) -> (error out=w15, queue out=w16)
  w17 = $"number of samples per USRP fetch"
  s1 = w15  # shift register
  s2 = w16  # shift register
  while (iteration -> i1) {
    Get Notifier Status(notifier=w14) -> (latest notification=w18)
    # Producer loop
    case (w18) {
      frame True {
        w19 = w11
        w20 = s2
        w21 = s1
      }
      frame False {
        call "niUSRP Fetch Rx Data (CDB).gvi"(session handle=w11, error in=s1, number of samples=w17, channel list=w1) -> (session handle out=w19, error out=w22, data=w23)
        Enqueue Element(element=w23, error in=w22, queue=s2) -> (error out=w21, queue out=w20)
        call "NotifyError.gvi"(notifier ref=w14, error in=w21)
      }
    }
    $"enqueueing iteration" <- i1
    next s1 = w21
    next s2 = w20
    stop if w18
  }
  Obtain Queue(element data type=u8[] [], error in=w13) -> (error out=w24, queue out=w25)
  s3 = w15  # shift register
  s4 = w16  # shift register
  s5 = uninitialised  # shift register
  s6 = c128[] []  # shift register
  while (iteration -> i2) {
    Dequeue Element(error in=s3, queue=s4) -> (element=w26, queue out=w27)
    Get Queue Status(queue=w27) -> (# elements in queue=w28)
    $"number elements in queue" <- w28
    Insert Into Array(inArray=s6, new=w26) -> w29
    Array Size(array=w29) -> (size(s)=w30)
    # Consumer loop
    w31 = $"barker code"
    w32 = $"sync frame index (symbols)"
    w33 = $"message length (symbols)"
    w34 = $"Symbol rate (sym/s)"
    To Double Precision Float(number=w34) -> w35
    Divide(x=w8, y=w35) -> w36
    call "BarkerCode.gvi"() -> (length of one subcode=w37, subcodes=w38)
    Multiply(w37, w38) -> w39
    Add(w33, w39) -> w40
    To Long Integer(number=w36) -> w41
    Multiply(w40, w41) -> w42
    Multiply(w42, 1) -> w43
    w44 = $"Extra buffer backwards"
    s7 = w44  # shift register
    s8 = s5  # shift register
    s9 = uninitialised  # shift register
    while {
      Tick Count() -> (timer value=w45)
      Subtract(x=w45, y=s9) -> w46
      Reciprocal(x=w46) -> w47
      Multiply(w47, 1000) -> w48
      $FPS <- w48
      $milliseconds <- w46
      case ($"preamble?") {
        frame False, Default {
          call "PacketDetector.gvi"(input=w29, Power Threshold=$"Power Threshold", window length=$"window length") -> (detected?=w49)
          w50 = w15
        }
        frame True {
          call "PacketDetectorPreamble.gvi"(input=w29, Samples per symbol=w36, index=s7, error in=w15, Correlation threshold=$"Correlation threshold", window length=$"window length", preamble code=$"preamble code") -> (detected?=w49, max correlation=w51, error out=w50)
          $"max correlation" <- w51
        }
      }
      Array Size(array=w29) -> (size(s)=w52)
      Subtract(x=s7, y=w44) -> w53
      Is Greater Or Equal To 0(x=w53) -> w54
      # Add buffer
      # w55: index - buffer
      case (w54) {
        frame False, Default {
          w55 = s7
        }
        frame True {
          w55 = w53
        }
      }
      # s7: current index
      Multiply(w44, 2) -> w56
      # w57: length + buffer
      # length to check
      Add(w56, w43) -> w57
      case (w49) {
        frame False, Default {
          # w44: Extra buffer backwards
          Add($"window length", s7) -> w59
          # w59: next index
          Subtract(x=w52, y=w59) -> w63
          Is Less Or Equal To 0(x=w63) -> w58
          # check if done
          case (w58) {
            frame False, Default {
              w61 = c128[] []
            }
            frame True {
              Subtract(x=w52, y=$y) -> w64
              Array Subset(array=w29, index0=w64) -> w61
            }
          }
          w60 = w50
          w62 = s8
        }
        frame True {
          Array Subset(array=w29, index0=w55, length0=w57) -> w65
          Add(s7, w57) -> w59
          Subtract(x=w52, y=w59) -> w66
          Is Less Or Equal To 0(x=w66) -> w67
          # if total frame, run receiver block
          # check if total frame
          # Stop while loop if checked whole fetch
          # w52: length of fetch
          case (w67) {
            frame False, Default {
              case ($"receiver on") {
                frame False, Default {
                  w68 = i32[] []
                  w69 = w50
                }
                frame True {
                  call "Receiver.gvi"(Interleaver=$Interleaver, sync frame buffer (symbols)=$"sync frame buffer (symbols)", Signal in=w65, filter length=$"filter length", filter parameter=$"filter parameter", IQ rate=w8, Symbol rate (sym/s)=w34, Min correlation=$"Min correlation", error in=w50, message length (symbols)=w33, sync frame index (symbols)=w32, barker code=w31, Frame sync=$"Frame sync", Freq sync=$"Freq sync", decoding=$decoding) -> (IQ diagram=w70, output bit stream=w68, Correlation=w71, error out=w69)
                  $"IQ diagram" <- w70
                  $"sync frame correlation" <- w71
                }
              }
              case ($"Receive sound") {
                frame True {
                  Enqueue Element(element=w68, error in=w69, queue=w25) -> (error out=w60)
                  Array Size(array=w68) -> (size(s)=w72)
                  Is Greater Than 0(x=w72) -> w73
                  case (w73) {
                    frame False, Default { }
                    frame True {
                      call "MT Pack Bits.gvi"(input bit stream=w68, bits per integer=8, packed bit order="MSB first", integer format="Unsigned") -> (output integers=w74)
                      Byte Array To String(encoding="Extended ASCII", unsigned byte array=w74) -> (string=w75)
                      $string <- w75
                    }
                  }
                  w62 = f64[] []
                }
                frame False {
                  call "Example signal.gvi"(message length (bits)=w33) -> (output bit stream=w76)
                  call "BER.gvi"(Output bit stream=w68, Input bit stream=w76, Array in=s8, error in=w69, Reset BER=$"Reset BER") -> (Correct Size=w77, Output array size=w78, Input array size=w79, current BER=w80, Mean_BER=w81, BER graph=w82, BER array=w62, error out=w60)
                  $"current BER" <- w80
                  $Mean_BER <- w81
                  $"BER graph" <- w82
                  $"Input array size" <- w79
                  $"Output array size" <- w78
                  $"Correct Size" <- w77
                }
              }
              Array Size(array=w65) -> (size(s)=w83)
              $"size(s)" <- w83
              Absolute Value(x=w65) -> w84
              $"one package" <- w84
              w61 = c128[] []
            }
            frame True {
              # if not total frame, append to next fetch
              Array Subset(array=w29, index0=w55) -> w61
              w60 = w50
              w62 = s8
            }
          }
          Subtract(x=w52, y=w59) -> w85
          # next index = current index + frame length +buffer
          Is Less Or Equal To 0(x=w85) -> w58
          # w59: Index + frame length + buffer
          Wait(time to wait=$"milliseconds to wait")
        }
      }
      $"current index" <- s7
      next s7 = w59
      next s8 = w62
      next s9 = w45
      stop if w58
    }
    Array Size(array=w61) -> (size(s)=w86)
    Subtract(x=w30, y=w86) -> w87
    Array Subset(array=w29, length0=w87) -> w88
    # w61: array to next fetch
    Absolute Value(x=w88) -> w89
    $"Raw input" <- w89
    $"samples/symbol" <- w36
    Get Notifier Status(notifier=w14) -> (latest notification=w90, notifier out=w91)
    call "NotifyError.gvi"(notifier ref=w91, Notify anyway=$Stop_RX_2)
    $"dequeueing iteration" <- i2
    next s3 = w60
    next s4 = w27
    next s5 = s8
    next s6 = w61
    stop if w90
  }
  Release Queue(error in=s3, queue=s4) -> (error out=w92)
  call "niUSRP Abort.gvi"(session handle=w19, error in=w92) -> (session handle out=w93, error out=w94)
  call "niUSRP Close Session.gvi"(session handle=w93, error in=w94) -> (error out=w95)
  $"error out" <- w95
  $"actual IQ rate" <- w8
  $"actual carrier frequency" <- w9
  $"actual gain (dB)" <- w10
  call "Sink.gvi"(queue=w25, notifier ref=w14, error in=w24, net address_2="127.0.0.1", sink port=36363)
