vi "Sink.gvi"   [LabVIEW NXG 3.0.0]
inputs:
  "error in": error
  "queue": Queue<u8[]>
  "port": u16 = 36363
  "net address": string = "127.0.0.1"
  "connection ID in": UdpNetworkConnectionRefnum
outputs:
  "queue out": Queue<u8[]>
  "output": u8[]
  "error out_2": error
uses:
  NI::Modulation::MT Pack Bits.gvi
diagram:
  Dequeue Element(error in=$"error in", queue=$queue) -> (element=w1, error out=w2, queue out=w3)
  $"queue out" <- w3
  Array Size(array=w1) -> (size(s)=w4)
  Is Greater Than 0(x=w4) -> w5
  case (w5) {
    frame False, Default {
      w6 = w2
      w7 = u8[] []
    }
    frame True {
      case (FALSE) {
        frame False, Default {
          w8 = w2
          w7 = w1
        }
        frame True {
          call "MT Pack Bits.gvi"(input bit stream=w1, bits per integer=8, packed bit order="MSB first", integer format="Unsigned", error in=w2) -> (output integers=w9, error out=w8)
          To Unsigned Byte Integer(number=w9) -> w7
        }
      }
      Udp Write Binary(address=$"net address", connection ID=$"connection ID in", data in=w7, error in=w8, port or service name=$port) -> (error out=w6)
    }
  }
  $output <- w7
  $"error out_2" <- w6
