vi "TestFreqSync.gvi"   [LabVIEW NXG 3.0.0]
panel controls:
  "message length (bits)": i32 = 128
  "Samples per symbol": i32 = 16
  "frame insert index": i32 = 64
  "Insert frame": bool = TRUE
  "Error in": error
  "padding bits": i32
  "Min correlation threshold": f64 = 0.9
  "compensate": bool
  "frequency offset": f64
  "Barker code": enum{"5", "7", "11", "random"} = "random"
  "phase offset_2": f64
panel indicators:
  "error out_2": error
  "BER": f64
  "output bit stream": i8[]
  "estimated phase drift": f64
  "correlation": f64[]
  "actual phase drift": f64
  "intercept": f64
  "source bit stream": i8[]
  "after compensation": f64[]
  "before compensation": f64[]
  "estimated phase offset": f64
  "IQ diagram after": c128[]
  "IQ diagram before": c128[]
uses:
  NI::Analysis::Statistics::Mean (DBL).gvi
diagram:
  call "TestSync.gvi"(message length (bits)=$"message length (bits)", Samples per symbol=$"Samples per symbol", frame insert index=$"frame insert index", Insert frame=$"Insert frame", Error in=$"Error in", frequency offset=$"frequency offset", phase offset=$"phase offset_2", Barker code=$"Barker code", Min correlation threshold=$"Min correlation threshold", padding bits=$"padding bits") -> (framesync output=w1, Training Subcodes=w2, Graph=w3, source bit stream=w4, error out=w5, phase drift=w6)
  case ($compensate) {
    frame False, Default {
      w7 = w5
      w8 = w1
      w9 = 0
      w10 = 0
      w11 = 0
    }
    frame True {
      call "FreqSync.gvi"(input=w1, Training codes=w2, Samples per symbol=$"Samples per symbol", Frame index=$"frame insert index", error in=w5, barker code=$"Barker code") -> (correction angles=w12, output=w8, phase drift=w9, intercept=w10, phase offset=w11, error out=w7)
    }
  }
  $"IQ diagram after" <- w8
  Complex To Real Imaginary(x + iy=w8) -> (x=w13)
  $"after compensation" <- w13
  $"IQ diagram before" <- w1
  Complex To Real Imaginary(x + iy=w1) -> (x=w14)
  $"before compensation" <- w14
  $correlation <- w3
  call "RemoveSyncFrame.gvi"(input=w8, samples per symbol=$"Samples per symbol", sync frame index (bits)=$"frame insert index", barker code=$"Barker code") -> (output=w15)
  call "Downsampler.gvi"(input signal=w15, error in=w7, samples per symbol=$"Samples per symbol") -> (output signal=w16, error out=w17)
  case (w17) {
    frame Error, Default {
      w18 = w17
      w19 = i8[] []
    }
    frame No Error {
      call "BPSKDemod.gvi"(symbols=w16, error in=w17) -> (output bit stream=w19, error out=w18)
    }
  }
  Array Subset(array=w19, length0=$"message length (bits)") -> w20
  Is Not Equal(x=w4, y=w20) -> w21
  Boolean To Integer(Boolean=w21) -> (0, 1=w22)
  # Calculate BER
  case (w18) {
    frame Error, Default {
      w23 = w18
      w24 = -1
    }
    frame No Error {
      call "Mean (DBL).gvi"(x=w22, error in=w18) -> (mean=w24, error out=w23)
    }
  }
  $BER <- w24
  $"error out_2" <- w23
  $"estimated phase drift" <- w9
  $intercept <- w10
  $"actual phase drift" <- w6
  $"estimated phase offset" <- w11
  $"output bit stream" <- w20
  $"source bit stream" <- w4
