vi "TestSource.gvi"   [LabVIEW NXG 3.0.0]
panel controls:
  "error in": error
  "stop": bool
panel indicators:
  "Error out": error
  "element": u8[]
uses:
  source.mli::source matlab
  sink.mli::sink matlab
diagram:
  disable {
    frame Enabled {
      call "Source.gvi"(error in=$"error in") -> (Output=w1, error out=w2)
      while {
        Dequeue Element(error in=w2, queue=w1) -> (element=w3)
        $element <- w3
        stop if $stop
      }
    }
    frame Disabled { }
  }
  disable {
    frame Disabled {
      call "source matlab"() -> (data=w4)
      call "sink matlab"(data=w4)
    }
    frame Enabled { }
  }
