vi "TestSync.gvi"   [LabVIEW NXG 3.0.0]
inputs:
  "message length (bits)": i32 = 88
  "Error in": error
  "Samples per symbol": i32 = 16
  "frame insert index": i32 = 44
  "Barker code": enum{"5", "7", "11", "random"} = "random"
  "Min correlation threshold": f64
  "padding bits": i32 = 50
  "Insert frame": bool
  "frequency offset": f64
outputs:
  "Training Subcodes": c128[]
  "framesync output": c128[]
  "error out": error
  "Graph": f64[]
  "source bit stream": i8[]
  "phase error": f64
  "channel": c128[]
panel indicators:
  "BER": f64
  "output bit stream": i8[]
  "max index(es)": i32
  "Index should be at": i32
uses:
  NI::Modulation::MT Generate Bits (Fibonacci, PN Order).gvi
  NI::Analysis::Generation::Ramp Pattern by Samples.gvi
  NI::Analysis::Statistics::Mean (DBL).gvi
diagram:
  Multiply(6.28, $"frequency offset") -> w1
  # optional carrier frequency shift
  $"phase error" <- w1
  Multiply($"padding bits", $"Samples per symbol") -> w2
  Initialize Array(element=0+0i, size=w2) -> w3
  Random Number() -> (number (0 to 1)=w4)
  Multiply(w4, 1000) -> w5
  To Long Integer(number=w5) -> w6
  call "MT Generate Bits (Fibonacci, PN Order).gvi"(total bits=$"message length (bits)", PN sequence order=10, seed in=w6, error in=$"Error in") -> (output bit stream=w7, error out=w8)
  call "BPSKMod.gvi"(input bit stream=w7, error in=w8) -> (Symbol out=w9, error out=w10)
  case ($"Insert frame") {
    frame False, Default {
      w11 = w9
    }
    frame True {
      call "SyncFrameInserter.gvi"(Signal in=w9, insert index=$"frame insert index", Barker code=$"Barker code") -> (Signal out=w11)
    }
  }
  call "Upsampler.gvi"(Signal in=w11, Samples per symbol=$"Samples per symbol", error in=w10) -> (Upsampled signal=w12, error out=w13)
  Insert Into Array(inArray=w12, index0=0, new=w3) -> w14
  # add padding before and after message to simulate a IQ fetch
  Array Size(array=w14) -> (size(s)=w15)
  Insert Into Array(inArray=w14, index0=w15, new=w3) -> w16
  $channel <- w16
  Multiply($"frame insert index", $"Samples per symbol") -> w17
  Add(w2, w17) -> w18
  $"Index should be at" <- w18
  Array Size(array=w16) -> (size(s)=w19)
  Multiply(w1, w19) -> w20
  call "Ramp Pattern by Samples.gvi"(samples=w19, end=w20) -> (ramp pattern=w21)
  Add(w1, w21) -> w22
  Polar To Complex(r=1, theta=w22) -> (r * e^(i*theta)=w23)
  Multiply(w16, w23) -> w24
  call "FrameSync.gvi"(input signal=w24, samples per symbol=$"Samples per symbol", error in=w13, sync frame index (symbols)=$"frame insert index", barker code=$"Barker code", Min correlation=$"Min correlation threshold") -> (output signal=w25, Correlation=w26, max index=w27, Training Subcodes=w28, error out=w29)
  call "RemoveSyncFrame.gvi"(input=w25, samples per symbol=$"Samples per symbol", sync frame index (bits)=$"frame insert index", barker code=$"Barker code") -> (output=w30)
  call "Downsampler.gvi"(input signal=w30, message length=$"message length (bits)", error in=w29, samples per symbol=$"Samples per symbol") -> (output signal=w31, error out=w32)
  case (w32) {
    frame Error, Default {
      w33 = w32
      w34 = i8[] []
    }
    frame No Error {
      call "BPSKDemod.gvi"(symbols=w31, error in=w32) -> (output bit stream=w34, error out=w33)
    }
  }
  Is Not Equal(x=w7, y=w34) -> w35
  Boolean To Integer(Boolean=w35) -> (0, 1=w36)
  # Calculate BER
  case (w33) {
    frame Error, Default {
      w37 = w33
      w38 = -1
    }
    frame No Error {
      call "Mean (DBL).gvi"(x=w36, error in=w33) -> (mean=w38, error out=w37)
    }
  }
  $BER <- w38
  $"framesync output" <- w25
  $"source bit stream" <- w7
  $"error out" <- w37
  $"Training Subcodes" <- w28
  $"max index(es)" <- w27
  $"output bit stream" <- w34
  Absolute Value(x=w26) -> w39
  $Graph <- w39
