vi "TestUDP.gvi"   [LabVIEW NXG 3.0.0]
panel controls:
  "error in": error
  "source port": u16 = 26363
  "net address_2": string = "127.0.0.1"
  "sink port": u16 = 26363
panel indicators:
  "Error out": error
uses:
  NI::G Core::Error::Multiplex Errors.gvi
diagram:
  Obtain Notifier(element data type=bool TRUE, error in=$"error in", name="error") -> (error out=w1, notifier out=w2)
  Obtain Queue(element data type=u8[] []) -> (queue out=w3)
  call "Source.gvi"(queue=w3, notifier ref=w2, error in=w1, net address=$"net address_2", source port=$"source port") -> (error out=w4)
  call "Sink.gvi"(queue=w3, notifier ref=w2, error in=w1, net address_2=$"net address_2", sink port=$"sink port") -> (error out=w5)
  call "Multiplex Errors.gvi"(error in 1=w5, error in 2=w4) -> (error out=w6)
  Release Notifier(error in (no error)=w6, notifier=w2) -> (error out=w7)
  $"Error out" <- w7
