vi "Source.gvi"   [LabVIEW NXG 3.0.0]
inputs:
  "error in": error
  "queue in": Queue<u8[]>
  "last message": u8[]
outputs:
  "current messsage": u8[]
  "queue out_2": Queue<u8[]>
  "error out": error
  "received packet": u8[]
uses:
  source.mli::source matlab
  NI::Modulation::MT UnPack Bits.gvi
diagram:
  call "source matlab"(error in=$"error in") -> (data=w1, error out=w2)
  $"received packet" <- w1
  # Call matlab script
  call "MT UnPack Bits.gvi"(input integers=w1, bits per integer=8, packed bit order="MSB first", integer format="Unsigned", error in=w2) -> (output bit stream=w3, error out=w4)
  To Unsigned Byte Integer(number=w3) -> w5
  $"current messsage" <- w5
  Is Not Equal[ComparisonMode=CompareAggregates](x=$"last message", y=w5) -> w6
  case (w6) {
    frame False, Default {
      w7 = w4
      w8 = $"queue in"
    }
    frame True {
      Enqueue Element(element=w5, error in=w4, queue=$"queue in") -> (error out=w7, queue out=w8)
    }
  }
  $"queue out_2" <- w8
  $"error out" <- w7
