vi "TransmitterBlock.gvi"   [LabVIEW NXG 3.0.0]
panel controls:
  "IQ rate": f64 = 192000
  "carrier frequency": f64 = 2483000000
  "Active antenna": string = "TX1"
  "stop": bool
  "Device name": string = "USRP_06"
  "gain": f64 = 2.5
  "RF channel": string = "0"
  "filter parameter": f64 = 0.5
  "filter length": i32 = 8
  "Symbol rate (sym/s)": i32 = 12000
  "Barker insert index": i32 = 64
  "message length (bits)": i32 = 128
  "Barker code": enum{"5", "7", "11", "random"} = "11"
  "Padding length": i32 = 10
  "encode": bool
  "Frame sync": bool = TRUE
  "Send sound": bool
  "Interleaver": bool = TRUE
  "source port": u16 = 26363
  "net address_2": string = "127.0.0.1"
  "preamble?": bool = TRUE
  "Preamble code": enum{"5", "7", "11", "random"} = "7"
  "Flush_queue": bool
  "Interleaver mode": enum{"TX", "RX", "TX Block", "RX Block"} = "TX"
panel indicators:
  "actual IQ rate": f64
  "actual carrier frequency": f64
  "actual gain (dB)": f64
  "error out": error
  "Baseband Waveform (absolute value)": waveform<f64>
  "IQ diagram": c128[]
  "actual message length": i32
  "Transmitting": bool
  "number elements in queue": i32
  "milliseconds": u32
  "FPS": f64
  "Underflow?": bool  # specific error cleared? indicates whether the error referenced by specific error code to clear has been cleared.
uses:
  NI::USRP::niUSRP Open Tx Session.gvi
  NI::USRP::niUSRP Configure Signal.gvi
  NI::USRP::niUSRP Write Tx Data (CDB).gvi
  NI::G Core::Error::Filter Error Code.gvi
  NI::USRP::niUSRP Close Session.gvi
  NI::G Core::Error::Multiplex Errors.gvi
diagram:
  w1 = $"RF channel"
  call "niUSRP Open Tx Session.gvi"(device names=$"Device name") -> (session handle out=w2, error out=w3)
  Property Node(instance in=w2, "niUSRP"=w1, error in=w3) -> (error out=w4, instance out=w5)
  call "niUSRP Configure Signal.gvi"(active antenna=$"Active antenna", session handle=w5, error in=w4, IQ rate=$"IQ rate", carrier frequency=$"carrier frequency", gain=$gain, channel list=w1) -> (session handle out=w6, error out=w7, coerced IQ rate=w8, coerced carrier frequency=w9, coerced gain=w10)
  Obtain Notifier(element data type=bool TRUE, error in=w7, name="error") -> (error out=w11, notifier out=w12)
  Obtain Queue(element data type=u8[] []) -> (queue out=w13)
  # UDP Source
  call "Source.gvi"(queue=w13, notifier ref=w12, error in=w11, net address=$"net address_2", source port=$"source port") -> (error out=w14)
  s1 = uninitialised  # shift register
  s2 = FALSE  # shift register
  s3 = uninitialised  # shift register
  while (iteration -> i1) {
    Tick Count() -> (timer value=w15)
    Subtract(x=w15, y=s1) -> w16
    Reciprocal(x=w16) -> w17
    Multiply(w17, 1000) -> w18
    $FPS <- w18
    $milliseconds <- w16
    Get Notifier Status(notifier=w12) -> (latest notification=w19)
    case (w19) {
      frame True {
        w20 = w7
        w21 = w6
        w22 = s2
      }
      frame False {
        case ($Flush_queue) {
          frame False, Default { }
          frame True {
            Flush Queue(queue=w13)
          }
        }
        case ($"Send sound") {
          frame False, Default {
            call "Example signal.gvi"(message length (bits)=$"message length (bits)") -> (output bit stream=w23)
            w24 = w7
            w25 = TRUE
            w22 = s2
            w26 = FALSE
          }
          frame True {
            Get Queue Status(queue=w13) -> (# elements in queue=w27)
            $"number elements in queue" <- w27
            case (s2) {
              frame False, Default {
                w23 = u8[] []
              }
              frame True {
                Dequeue Element(queue=w13, timeout in ms=15) -> (element=w23)
              }
            }
            Is Less(x=w27, y=2) -> w28
            Logical And(w28, s2) -> w26
            Not(x=w26) -> w29
            Is Greater(x=w27, y=100) -> w30
            Not(x=s2) -> w31
            Logical And(w30, w31) -> w32
            Not(x=w32) -> w33
            Logical And(w29, w33, s2) -> w34
            # Hysteresis control loop to prevent underflow of the USRP
            # yes, i know, embrace the labview spagetti
            Logical And(w29, w32) -> w35
            Logical Or(w34, w35) -> w22
            w24 = w7
            w25 = s2
          }
        }
        Array Size(array=w23) -> (size(s)=w36)
        Subtract(x=$"message length (bits)", y=w36) -> w37
        # Pads zeros if the message
        # is too short
        call "ZeroPaddingInt.gvi"(Input=w23, Padding length=w37, samples per symbol=1, pad beginning=FALSE, pad end=TRUE) -> (output array=w38)
        Is Greater(x=w36, y=0) -> w39
        Logical And(w39, w25) -> w40
        case (w40) {
          frame False, Default {
            w41 = $stop
            w20 = w24
            w21 = w6
          }
          frame True {
            call "Transmitter.gvi"(filter parameter=$"filter parameter", filter length=$"filter length", Interleaver=$Interleaver, Interleaver mode=$"Interleaver mode", input bit stream=w38, IQ rate=w8, Symbol rate (sym/s)=$"Symbol rate (sym/s)", Frame sync=$"Frame sync", error in=w24, Barker code=$"Barker code", Barker insert index=$"Barker insert index", encode=$encode, preamble?=$"preamble?", Preamble code=$"Preamble code") -> (signal out=w42, IQ diagram=w43, error out=w44)
            $"IQ diagram" <- w43
            Divide(x=w8, y=$"Symbol rate (sym/s)") -> w45
            call "ZeroPaddingDbl.gvi"(Input=w42, Padding length=$"Padding length", samples per symbol=w45, pad beginning=TRUE, pad end=FALSE) -> (output array=w46)
            Logical Or(w26, $stop) -> w47
            call "niUSRP Write Tx Data (CDB).gvi"(session handle=w6, error in=w44, data=w46, end of data?=w47, channel list=w1) -> (session handle out=w21, error out=w48)
            # ignore underflow
            call "Filter Error Code.gvi"(error in=w48, code to clear=-1074118645) -> (error out=w20, error cleared?=w49)
            $"Underflow?" <- w49
            Absolute Value(x=w46) -> w50
            Reciprocal(x=$"Symbol rate (sym/s)") -> w51
            Build Waveform Node(Y=w50, dt=w51) -> (output waveform=w52)
            $"Baseband Waveform (absolute value)" <- w52
            w41 = $stop
          }
        }
        call "NotifyError.gvi"(notifier ref=w12, Notify anyway=w41, error in=w20)
        $"actual message length" <- w36
        $Transmitting <- w40
      }
    }
    next s1 = w15
    next s2 = w22
    next s3 = w16
    stop if w19
  }
  call "niUSRP Close Session.gvi"(session handle=w21, error in=w20) -> (error out=w53)
  call "Multiplex Errors.gvi"(error in 1=w14, error in 2=w53) -> (error out=w54)
  Release Notifier(error in (no error)=w54, notifier=w12) -> (error out=w55)
  $"error out" <- w55
  $"actual IQ rate" <- w8
  $"actual carrier frequency" <- w9
  $"actual gain (dB)" <- w10
